% Simulink data dictionary cam_data_mc.sldd

CAMc_flgCustomRampActive = Simulink.Parameter(1, StorageClass="ExportedGlobal", DataType="boolean", Min=0, Max=1, Unit="bool")
CAMm_IP2CLC_mA_z = Simulink.Parameter([1100 1000 900 800 730 650 600 550 500 450 400 350 300 250 200 150 100 50], StorageClass="ExportedGlobal", DataType="double", Min=0, Max=2000, Unit="mA")
CAMm_IP2CLC_bar_x = Simulink.Parameter([0 0.253 2.296 4.48 6.303 8.32 10.093 11.82 13.31 14.66 15.876 17.096 18.296 18.793 19.146 19.36 19.753 19.803], StorageClass="ExportedGlobal", DataType="double", Min=0, Max=70, Unit="bar")
CAMc_ItermPressCtrl_mApbar = Simulink.Parameter(0.2, StorageClass="ExportedGlobal", DataType="double", Min=0, Max=100, Unit="mApbar")
CAMc_IDmdC1BOB_mA = Simulink.Parameter(0, StorageClass="ExportedGlobal", DataType="double", Min=0, Max=2000, Unit="mA")
CAMc_enumStateC1BOB = Simulink.Parameter(2, StorageClass="ExportedGlobal", DataType="double", Min=0, Max=10, Unit="enum")
CAMc_trqCapMaxC1BOB_Nm = Simulink.Parameter(0, StorageClass="ExportedGlobal", DataType="double", Min=0, Max=300, Unit="Nm")
CAMc_numBOBOutputsC1 = Simulink.Parameter(0, StorageClass="ExportedGlobal", DataType="uint16", Min=0, Max=11011, Unit="num")
CAMc_pressDmdC1BOB_bar = Simulink.Parameter(0, StorageClass="ExportedGlobal", DataType="double", Unit="bar")