% Simulink data dictionary cpm_data_mc.sldd

CPM_ENUMCPMINIT = Simulink.Parameter(0, StorageClass="ExportedGlobal", DataType="uint8", Min=0, Max=0, Unit="enum")
CPM_ENUMCPMSTDBY = Simulink.Parameter(1, StorageClass="ExportedGlobal", DataType="uint8", Min=1, Max=1, Unit="enum")
CPM_enumStateSM = Simulink.Signal(StorageClass="ExportedGlobal", DataType="uint8", Unit="enum")
CPM_flgInitDone = Simulink.Signal(StorageClass="ExportedGlobal", DataType="boolean", Min=0, Max=1, Unit="bool")