% Simulink data dictionary global_data_mc.sldd

GBL_TRUE = Simulink.Parameter(1, StorageClass="ExportedGlobal", DataType="boolean", Min=1, Max=1, Unit="bool")
GBL_FALSE = Simulink.Parameter(0, StorageClass="ExportedGlobal", DataType="boolean", Min=0, Max=0, Unit="bool")
GBL_ENUMFALSE = Simulink.Parameter(0, StorageClass="ExportedGlobal", DataType="uint8", Min=0, Max=0, Unit="enum")
GBL_ENUMTRUE = Simulink.Parameter(1, StorageClass="ExportedGlobal", DataType="uint8", Min=1, Max=1, Unit="enum")
GBL_ENUMFAILED = Simulink.Parameter(255, StorageClass="ExportedGlobal", DataType="uint8", Min=255, Max=255, Unit="enum")
GBL_NUMZERO = Simulink.Parameter(0, StorageClass="ExportedGlobal", DataType="double", Min=0, Max=0, Unit="num")
GBL_NUMONE = Simulink.Parameter(1, StorageClass="ExportedGlobal", DataType="double", Min=1, Max=1, Unit="num")
GBL_NUMMINUSONE = Simulink.Parameter(-1, StorageClass="ExportedGlobal", DataType="double", Min=-1, Max=-1, Unit="num")
GBL_TIMERXLDT_s = Simulink.Parameter(0.005, StorageClass="ExportedGlobal", DataType="double", Min=0.001, Max=1, Unit="s")
GBL_NUMTWO = Simulink.Parameter(2, StorageClass="ExportedGlobal", DataType="double", Min=2, Max=2, Unit="num")
GBL_TIMEICMDT_s = Simulink.Parameter(0.005, StorageClass="ExportedGlobal", DataType="double", Min=0.001, Max=1, Unit="s")
GBL_MIN_SEC = Simulink.Parameter(60, StorageClass="ExportedGlobal", DataType="double", Min=0, Max=100, Unit="fact")
GBL_SPDSHAFTZERO_rpm = Simulink.Parameter(0, StorageClass="ExportedGlobal", DataType="double", Min=0, Max=0, Unit="rpm")
GBLc_FaultResetCode = Simulink.Parameter(0, StorageClass="ExportedGlobal", DataType="uint16", Min=0, Max=65000, Unit="num")
GBL_FAULTRESETCODE = Simulink.Parameter(12345, StorageClass="ExportedGlobal", DataType="uint16", Min=0, Max=65000, Unit="num")
GBL_ENUMSTATUSFAILED = Simulink.Parameter(255, StorageClass="ExportedGlobal", DataType="uint8", Min=255, Max=255, Unit="enum")
GBL_ENUMSTATUSOK = Simulink.Parameter(1, StorageClass="ExportedGlobal", DataType="uint8", Min=1, Max=1, Unit="enum")
GBL_ENUMSTATUSINIT = Simulink.Parameter(0, StorageClass="ExportedGlobal", DataType="uint8", Min=0, Max=0, Unit="enum")
GBL_NUMHALF = Simulink.Parameter(0.5, StorageClass="ExportedGlobal", DataType="double", Min=0.5, Max=0.5, Unit="num")
GBL_ZEROPRESS_bar = Simulink.Parameter(0, StorageClass="ExportedGlobal", DataType="double", Min=0, Max=0, Unit="bar")
GBL_VOLTAGEZERO_V = Simulink.Parameter(0, StorageClass="ExportedGlobal", DataType="double", Min=0, Max=0, Unit="V")
GBL_TEMPZERO_degC = Simulink.Parameter(0, StorageClass="ExportedGlobal", DataType="double", Min=0, Max=0, Unit="degC")
GBL_TIMEPMMDT_s = Simulink.Parameter(0.005, StorageClass="ExportedGlobal", DataType="double", Min=0.001, Max=1, Unit="s")
GBL_BOBCODE = Simulink.Parameter(11011, StorageClass="ExportedGlobal", DataType="uint16", Min=0, Max=11011, Unit="num")
GBL_TIMESYSDT_s = Simulink.Parameter(0.005, StorageClass="ExportedGlobal", DataType="double", Min=0.001, Max=1, Unit="s")
GBL_TIMESBSDT_s = Simulink.Parameter(0.005, StorageClass="ExportedGlobal", DataType="double", Min=0.001, Max=1, Unit="s")
GBL_NUMPI = Simulink.Parameter(3.1416, StorageClass="ExportedGlobal", DataType="double", Min=3.1416, Max=3.1416, Unit="num")
GBL_NUMFOUR = Simulink.Parameter(4, StorageClass="ExportedGlobal", DataType="double", Min=4, Max=4, Unit="num")
GBL_RATIOENG2PRIM = Simulink.Parameter(1, StorageClass="ExportedGlobal", DataType="double", Unit="rat")
GBL_NUMONEMILLION = Simulink.Parameter(1000000, StorageClass="ExportedGlobal", DataType="double", Min=1000000, Max=1000000, Unit="num")
GBL_100PCT = Simulink.Parameter(100, StorageClass="ExportedGlobal", DataType="double", Min=0, Max=100, Unit="pct")
GBL_PASCAL_BAR = Simulink.Parameter(1.0e-5, StorageClass="ExportedGlobal", DataType="double", Unit="fact")
GBL_TIMETSTDT_s = Simulink.Parameter(0.005, StorageClass="ExportedGlobal", DataType="double", Min=0.001, Max=1, Unit="s")
GBLc_spdCluSlipDeadBand_rpm = Simulink.Parameter(100, StorageClass="ExportedGlobal", DataType="double", Min=0, Max=1000, Unit="rpm")
GBL_RADTYREREAR_m = Simulink.Parameter(0.343, StorageClass="ExportedGlobal", DataType="double", Min=0, Max=127, Unit="m")
GBL_RATIOAXEL2OSS = Simulink.Parameter(0.1785, StorageClass="ExportedGlobal", DataType="double")
GBL_KPH_MPH = Simulink.Parameter(1.609, StorageClass="ExportedGlobal", DataType="double", Unit="fac")
GBL_MPS_KPH = Simulink.Parameter(3.6, StorageClass="ExportedGlobal", DataType="double", Unit="fac")
GBL_GRAVITY_mps2 = Simulink.Parameter(9.81, StorageClass="ExportedGlobal", DataType="double", Unit="mps")
GBL_KPH_MPS = Simulink.Parameter(0.278, StorageClass="ExportedGlobal", DataType="double", Unit="fact")
GBL_A_mA = Simulink.Parameter(1000, StorageClass="ExportedGlobal", DataType="double", Min=1000, Max=1000, Unit="fact")
GBL_NUMONETHOUSAND = Simulink.Parameter(1000, StorageClass="ExportedGlobal", DataType="double", Min=1000, Max=1000, Unit="num")
GBL_SEC_MSEC = Simulink.Parameter(1000, StorageClass="ExportedGlobal", DataType="double", Min=0, Max=1000)
GBL_TIMECYCLE01DT_s = Simulink.Parameter(0.001, StorageClass="ExportedGlobal", Min=0.001, Max=0.1, Unit="s")