% Simulink data dictionary icm_data_mc.sldd

ICM_timeSpdSensTimeOut_s = Simulink.Parameter(2, StorageClass="ExportedGlobal", DataType="double", Min=0.001, Max=2, Unit="s")
ICMc_numTeethInpShaftC1 = Simulink.Parameter(36, StorageClass="ExportedGlobal", DataType="double", Min=0, Max=250, Unit="Teeth")
ICMc_numInpShaft1SpdSensRatio = Simulink.Parameter(1, StorageClass="ExportedGlobal", DataType="double", Min=0, Max=255, Unit="num")
ICMc_timeSpdSensTout_s = Simulink.Parameter(1, StorageClass="ExportedGlobal", DataType="double", Min=0, Max=5, Unit="s")
ICMc_spdSecSheaveMax_rpm = Simulink.Parameter(11000, StorageClass="ExportedGlobal", DataType="double", Min=0, Max=12000, Unit="rpm")
ICMc_spdPrimSheaveMax_rpm = Simulink.Parameter(11000, StorageClass="ExportedGlobal", DataType="double", Min=0, Max=12000, Unit="rpm")
ICMc_numTeethOutShaft = Simulink.Parameter(68, StorageClass="ExportedGlobal", DataType="double", Min=0, Max=250, Unit="Teeth")
ICMc_numOutShaftSpdSensRatio = Simulink.Parameter(1, StorageClass="ExportedGlobal", DataType="double", Min=0, Max=255, Unit="num")
ICMc_spdOutShaftDirLockHi_rpm = Simulink.Parameter(400, StorageClass="ExportedGlobal", DataType="double", Min=0, Max=800, Unit="rpm")
ICMc_spdOutShaftDirLockLo_rpm = Simulink.Parameter(300, StorageClass="ExportedGlobal", DataType="double", Min=0, Max=800, Unit="rpm")
ICMc_spdChnDiffOutSpdMax_rpm = Simulink.Parameter(7000, StorageClass="ExportedGlobal", DataType="double", Min=0, Max=12000, Unit="rpm")
ICMc_spdOutShaftMax_rpm = Simulink.Parameter(11500, StorageClass="ExportedGlobal", DataType="double", Min=0, Max=12000, Unit="rpm")
ICMc_vCluPressC1SensOffset_V = Simulink.Parameter(-0.5, StorageClass="ExportedGlobal", DataType="double", Min=-7, Max=7, Unit="V")
ICM_VSENSOPEN_V = Simulink.Parameter(4.875, StorageClass="ExportedGlobal", DataType="double", Min=-7, Max=7, Unit="V")
ICM_VSENSSHORT_V = Simulink.Parameter(0.125, StorageClass="ExportedGlobal", DataType="double", Min=-7, Max=7, Unit="V")
ICMc_facGainClu1SensPress_barpV = Simulink.Parameter(13.9288, StorageClass="ExportedGlobal", DataType="double", Min=0, Max=300, Unit="barpV")
ICMc_timeCluPressSensTout_s = Simulink.Parameter(1, StorageClass="ExportedGlobal", DataType="double", Min=0, Max=5, Unit="s")
ICMc_vCluPressC2SensOffset_V = Simulink.Parameter(-0.5, StorageClass="ExportedGlobal", DataType="double", Min=-7, Max=7, Unit="V")
ICMc_facGainClu2SensPress_barpV = Simulink.Parameter(14.3153, StorageClass="ExportedGlobal", DataType="double", Min=0, Max=300, Unit="barpV")
ICMc_pressPressC2SensOffset_bar = Simulink.Parameter(-0.454, StorageClass="ExportedGlobal", DataType="double", Min=-5, Max=5, Unit="bar")
ICMc_pressPressC1SensOffset_bar = Simulink.Parameter(-0.125, StorageClass="ExportedGlobal", DataType="double", Min=-5, Max=5, Unit="bar")
ICMc_vLinePressSensOffset_V = Simulink.Parameter(-0.5, StorageClass="ExportedGlobal", DataType="double", Min=-7, Max=7, Unit="V")
ICMc_facGainLineSensPress_barpV = Simulink.Parameter(25, StorageClass="ExportedGlobal", DataType="double", Min=0, Max=300, Unit="barpV")
ICMc_pressLinePressOffset_bar = Simulink.Parameter(0, StorageClass="ExportedGlobal", DataType="double", Min=-5, Max=5, Unit="bar")
ICMc_timeLinePressSensTout_s = Simulink.Parameter(1, StorageClass="ExportedGlobal", DataType="double", Min=0, Max=5, Unit="s")
ICMc_vLaunchPressSensOffset_V = Simulink.Parameter(-0.5, StorageClass="ExportedGlobal", DataType="double", Min=-7, Max=7, Unit="V")
ICMc_facGainLaunchSensPress_barpV = Simulink.Parameter(17.584, StorageClass="ExportedGlobal", DataType="double", Min=0, Max=300, Unit="barpV")
ICMc_pressLaunchPressOffset_bar = Simulink.Parameter(-0.42, StorageClass="ExportedGlobal", DataType="double", Min=-5, Max=5, Unit="bar")
ICMc_timeLaunchPressSensTout_s = Simulink.Parameter(1, StorageClass="ExportedGlobal", DataType="double", Min=0, Max=5, Unit="s")
ICMc_vPTLPressSensOffset_V = Simulink.Parameter(-0.5, StorageClass="ExportedGlobal", DataType="double", Min=-7, Max=7, Unit="V")
ICMc_facGainPTLSensPress_barpV = Simulink.Parameter(17.584, StorageClass="ExportedGlobal", DataType="double", Min=0, Max=300, Unit="barpV")
ICMc_pressPTLPressOffset_bar = Simulink.Parameter(-0.34, StorageClass="ExportedGlobal", DataType="double", Min=-5, Max=5, Unit="bar")
ICMc_timePTLPressSensTout_s = Simulink.Parameter(1, StorageClass="ExportedGlobal", DataType="double", Min=0, Max=5, Unit="s")
ICMc_timeEStopSensTout_s = Simulink.Parameter(1, StorageClass="ExportedGlobal", DataType="double", Min=0, Max=5, Unit="s")
ICMc_timeKL15SensTout_s = Simulink.Parameter(1, StorageClass="ExportedGlobal", DataType="double", Min=0, Max=5, Unit="s")
ICMm_tempOilSumpVNew_degC_z = Simulink.Parameter([140 130 120 110 100 90 80 70 60 50 40 25 20 10 0 -10 -20 -30 -40], StorageClass="ExportedGlobal", DataType="double", Min=-50, Max=200, Unit="degC")
ICMm_tempOilSumpNew_V_x = Simulink.Parameter([0.074 0.093 0.117 0.149 0.191 0.246 0.322 0.424 0.562 0.754 0.999 1.522 1.736 2.232 2.782 3.333 3.834 4.237 4.53], StorageClass="ExportedGlobal", DataType="double", Min=-7, Max=7, Unit="V")
ICMc_tempMimSump_degC = Simulink.Parameter(-50, StorageClass="ExportedGlobal", DataType="double", Min=-120, Max=20, Unit="degC")
ICMc_tempMaxSump_degC = Simulink.Parameter(150, StorageClass="ExportedGlobal", DataType="double", Min=0, Max=250, Unit="degC")
ICMc_timeOilSumpSensTout_s = Simulink.Parameter(1, StorageClass="ExportedGlobal", DataType="double", Min=0, Max=5, Unit="s")
ICM_pressC1_bar = Simulink.Signal(StorageClass="ExportedGlobal", DataType="double", Min=0, Max=70, Unit="bar")
ICM_enumStatusC1PressSens = Simulink.Signal(StorageClass="ExportedGlobal", DataType="uint8", Min=0, Max=255, Unit="enum")
ICM_pressC2_bar = Simulink.Signal(StorageClass="ExportedGlobal", DataType="double", Min=0, Max=70, Unit="bar")
ICM_enumStatusC2PressSens = Simulink.Signal(StorageClass="ExportedGlobal", DataType="uint8", Min=0, Max=255, Unit="enum")
ICM_pressLine_bar = Simulink.Signal(StorageClass="ExportedGlobal", DataType="double", Min=0, Max=70, Unit="bar")
ICM_enumStatusLineSens = Simulink.Signal(StorageClass="ExportedGlobal", DataType="uint8", Min=0, Max=255, Unit="enum")
ICM_pressLaunchClu_bar = Simulink.Signal(StorageClass="ExportedGlobal", DataType="double", Min=0, Max=70, Unit="bar")
ICM_enumStatusLaunchSens = Simulink.Signal(StorageClass="ExportedGlobal", DataType="uint8", Min=0, Max=255, Unit="enum")
ICM_pressPTLClu_bar = Simulink.Signal(StorageClass="ExportedGlobal", DataType="double", Min=0, Max=70, Unit="bar")
ICM_enumStatusPTLSens = Simulink.Signal(StorageClass="ExportedGlobal", DataType="uint8", Min=0, Max=255, Unit="enum")
ICM_tempOilSump_degC = Simulink.Signal(StorageClass="ExportedGlobal", DataType="double", Min=-120, Max=250, Unit="degC")
ICM_enumStatusOilSumpTempSens = Simulink.Signal(StorageClass="ExportedGlobal", DataType="uint8", Min=0, Max=255, Unit="enum")
ICM_flgEstopOn = Simulink.Signal(StorageClass="ExportedGlobal", DataType="boolean", Min=0, Max=1, Unit="bool")
ICM_flgExternalFaultOn = Simulink.Signal(StorageClass="ExportedGlobal", DataType="boolean", Min=0, Max=1, Unit="bool")
ICM_enumStatusEStopSens = Simulink.Signal(StorageClass="ExportedGlobal", DataType="uint8", Min=0, Max=255, Unit="enum")
ICM_flgKL15ON = Simulink.Signal(StorageClass="ExportedGlobal", DataType="boolean", Min=0, Max=1, Unit="bool")
ICM_enumStatusKL15Sens = Simulink.Signal(StorageClass="ExportedGlobal", DataType="uint8", Min=0, Max=255, Unit="enum")
ICM_spdClu1_rpm = Simulink.Signal(StorageClass="ExportedGlobal", DataType="double", Min=0, Max=8000, Unit="rpm")
ICM_enumStatusClu1SpdSens = Simulink.Signal(StorageClass="ExportedGlobal", DataType="uint8", Min=0, Max=255, Unit="enum")
ICM_spdClu2_rpm = Simulink.Signal(StorageClass="ExportedGlobal", DataType="double", Min=0, Max=8000, Unit="rpm")
ICM_enumStatusClu2SpdSens = Simulink.Signal(StorageClass="ExportedGlobal", DataType="uint8", Min=0, Max=255, Unit="enum")
ICM_spdOutShaft_rpm = Simulink.Signal(StorageClass="ExportedGlobal", DataType="double", Min=0, Max=10000, Unit="rpm")
ICM_enumStatusOutShaftSens = Simulink.Signal(StorageClass="ExportedGlobal", DataType="uint8", Min=0, Max=255, Unit="enum")
ICM_ENUMPRNLHUNKNOWN = Simulink.Parameter(255, StorageClass="ExportedGlobal", DataType="uint8", Min=255, Max=255, Unit="enum")
ICM_ENUMPRNLHPARK = Simulink.Parameter(0, StorageClass="ExportedGlobal", DataType="uint8", Min=0, Max=0, Unit="enum")
ICM_ENUMPRNLHREVERS = Simulink.Parameter(1, StorageClass="ExportedGlobal", DataType="uint8", Min=1, Max=1, Unit="enum")
ICM_ENUMPRNLHNEUTRAL = Simulink.Parameter(2, StorageClass="ExportedGlobal", DataType="uint8", Min=2, Max=2, Unit="enum")
ICM_ENUMPRNLHLOW = Simulink.Parameter(3, StorageClass="ExportedGlobal", DataType="uint8", Min=3, Max=3, Unit="enum")
ICM_ENUMPRNLHHIGH = Simulink.Parameter(4, StorageClass="ExportedGlobal", DataType="uint8", Min=4, Max=4, Unit="enum")
ICMc_ratePLCRatioCmdUP_ratps = Simulink.Parameter(0.1, StorageClass="ExportedGlobal", DataType="double", Unit="ratps")
ICMc_ratePLCRatioCmdDWN_ratps = Simulink.Parameter(0.1, StorageClass="ExportedGlobal", DataType="double", Unit="ratps")
ICMc_ratMinMapCmdSetPoint_gr = Simulink.Parameter(0.39, StorageClass="ExportedGlobal", DataType="double", Min=0.378, Max=2.631, Unit="rat")
ICMc_ratMaxMapCmdSetPoint_gr = Simulink.Parameter(2.631, StorageClass="ExportedGlobal", DataType="double", Min=0.378, Max=2.631, Unit="rat")
ICM_ENUMDRIVMODEPERF = Simulink.Parameter(2, StorageClass="ExportedGlobal", DataType="uint8", Min=2, Max=2, Unit="enum")
ICM_StateStandBy = Simulink.Parameter(1, StorageClass="ExportedGlobal", DataType="uint8", Min=1, Max=1, Unit="enum")
ICM_StatePTLSync = Simulink.Parameter(3, StorageClass="ExportedGlobal", DataType="uint8", Min=3, Max=3, Unit="enum")
ICM_StateBrakeLockUP = Simulink.Parameter(2, StorageClass="ExportedGlobal", DataType="uint8", Min=2, Max=2, Unit="enum")
ICMc_numSpdClu2tFiltConst = Simulink.Parameter(1, StorageClass="ExportedGlobal", DataType="double", Min=0, Max=1, Unit="num")
ICMc_numSpdClu1tFiltConst = Simulink.Parameter(0.1, StorageClass="ExportedGlobal", DataType="double", Min=0, Max=1, Unit="num")
ICMc_flgClu1FiltOn = Simulink.Parameter(1, StorageClass="ExportedGlobal", DataType="boolean", Min=0, Max=1, Unit="bool")
ICMc_flgClu2FiltOn = Simulink.Parameter(1, StorageClass="ExportedGlobal", DataType="boolean", Min=0, Max=1, Unit="bool")
ICMc_flgEngSpdFiltOn = Simulink.Parameter(1, StorageClass="ExportedGlobal", DataType="boolean", Min=0, Max=1, Unit="bool")
ICMc_numSpdPUFiltConst = Simulink.Parameter(0.1, StorageClass="ExportedGlobal", DataType="double", Min=0, Max=1, Unit="num")
ICMc_spdEngOnThreshold_rpm = Simulink.Parameter(500, StorageClass="ExportedGlobal", DataType="double", Min=0, Max=1200, Unit="rpm")
ICMc_spdEngOffThreshold_rpm = Simulink.Parameter(250, StorageClass="ExportedGlobal", DataType="double", Min=0, Max=1200, Unit="rpm")
ICMc_numEngineSpdSensRatio = Simulink.Parameter(1, StorageClass="ExportedGlobal", DataType="double", Min=0, Max=255, Unit="num")
ICMc_numClu2SpdSensRatio = Simulink.Parameter(5.964, StorageClass="ExportedGlobal", DataType="double", Unit="rat")
ICMc_numSpdOutShaftFiltConst = Simulink.Parameter(0.1, StorageClass="ExportedGlobal", DataType="double", Min=0, Max=1, Unit="num")
ICMc_flgAccOutShaftFiltOn = Simulink.Parameter(1, StorageClass="ExportedGlobal", DataType="boolean", Min=0, Max=1, Unit="bool")
ICMc_numAccOutShaftFiltConst = Simulink.Parameter(0.01, DataType="double", Min=0, Max=1)
ICMc_flgOutSpdSensFiltOnCopy = Simulink.Parameter(1, StorageClass="ExportedGlobal", DataType="boolean", Min=0, Max=1, Unit="bool")
ICMc_spdVehStoppedThresh_kph = Simulink.Parameter(2, StorageClass="ExportedGlobal", DataType="double", Unit="kph")
ICMc_spdVehRollingThresh_kph = Simulink.Parameter(5, StorageClass="ExportedGlobal", DataType="double", Unit="kph")
ICMc_rateVehSpdUP_mphps = Simulink.Parameter(1000, StorageClass="ExportedGlobal", DataType="double", Min=1000, Max=9000, Unit="mphps")
ICMc_rateVehSpdDWN_mphps = Simulink.Parameter(16, StorageClass="ExportedGlobal", DataType="double", Min=0, Max=1000, Unit="mphps")
ICMc_numAccVehFiltConst = Simulink.Parameter(0.05, StorageClass="ExportedGlobal", DataType="double", Min=0, Max=1, Unit="num")
ICMc_flgVehAccFiltOn = Simulink.Parameter(1, StorageClass="ExportedGlobal", DataType="boolean", Min=0, Max=1, Unit="bool")
ICMc_flgOutSpdSensFiltOn = Simulink.Parameter(1, StorageClass="ExportedGlobal", DataType="boolean", Min=0, Max=1, Unit="bool")
ICMc_ratControllerONThld = Simulink.Parameter(2.61, StorageClass="ExportedGlobal", DataType="double", Min=2.4, Max=2.631, Unit="rat")
ICMc_flgCtrlOnDmdBypassOn = Simulink.Parameter(1, StorageClass="ExportedGlobal", DataType="boolean", Min=0, Max=1, Unit="bool")
ICMc_flgActRatioControl = Simulink.Parameter(0, StorageClass="ExportedGlobal", DataType="boolean", Min=0, Max=1, Unit="bool")