% Simulink data dictionary ocm_data_mc.sldd

OCMc_numBOBSelectC1 = Simulink.Parameter(1, StorageClass="ExportedGlobal", DataType="uint8", Min=0, Max=16, Unit="num")
OCMc_numBOBSelectC2 = Simulink.Parameter(1, StorageClass="ExportedGlobal", DataType="uint8", Min=0, Max=16, Unit="num")
OCMc_numBOBSelectPTLClu = Simulink.Parameter(1, StorageClass="ExportedGlobal", DataType="uint8", Min=0, Max=16, Unit="num")
OCMc_numBOBSelectLine = Simulink.Parameter(1, StorageClass="ExportedGlobal", DataType="uint8", Min=0, Max=16, Unit="num")
OCM_ENUMENGSTARTENABLE = Simulink.Parameter(1, StorageClass="ExportedGlobal", DataType="uint8", Unit="enum")
OCM_ENUMENGSTARTDIS = Simulink.Parameter(0, StorageClass="ExportedGlobal", DataType="uint8", Unit="enum")
OCMc_numBOBOverrideEngStart = Simulink.Parameter(0, StorageClass="ExportedGlobal", DataType="uint16", Min=0, Max=11011, Unit="num")
OCMc_enumEngStartConsentBOB = Simulink.Parameter(1, StorageClass="ExportedGlobal", DataType="uint8", Min=0, Max=7, Unit="enum")
OCMm_IC1NachiDitherAmp_mA_z = Simulink.Parameter(repmat(400, 8, 8), StorageClass="ExportedGlobal", DataType="double", Min=0, Max=2000, Unit="mA")
OCMm_IC1NachiDitherAmp_degC_y = Simulink.Parameter([-40 -20 0 20 50 80 110 140], StorageClass="ExportedGlobal", DataType="double", Min=-120, Max=250, Unit="degC")
OCMm_IC1NachiDitherAmp_mA_x = Simulink.Parameter([0 200 400 600 1000 1100 1300 1500], StorageClass="ExportedGlobal", DataType="double", Min=0, Max=2000, Unit="mA")
OCMc_IBOBC1_mA = Simulink.Parameter(0, StorageClass="ExportedGlobal", DataType="double", Min=0, Max=2000, Unit="mA")
OCMm_freqCluPrimaryDitherFreq_Hz_z = Simulink.Parameter(repmat(40, 1, 8), StorageClass="ExportedGlobal", DataType="double", Min=0, Max=500, Unit="Hz")
OCMm_freqCluPrimaryDitherFreq_degC_x = Simulink.Parameter([-40 -20 0 20 50 80 110 140], StorageClass="ExportedGlobal", DataType="double", Min=-120, Max=250, Unit="degC")

OCMm_IC2NachiDitherAmp_mA_z = Simulink.Parameter([300 300 300 300 300 300 300 300
 300 300 300 300 300 300 300 300
 300 300 300 300 300 300 300 300
 500 500 500 500 500 500 500 500
 500 500 500 500 500 500 500 500
 500 500 500 500 500 500 500 500
 500 500 500 500 500 500 500 500
 500 500 500 500 500 500 500 500], StorageClass="ExportedGlobal", DataType="double", Min=0, Max=2000, Unit="mA")

OCMm_IC2NachiDitherAmp_degC_y = Simulink.Parameter([-40 -20 0 20 50 80 110 140], StorageClass="ExportedGlobal", DataType="double", Min=-120, Max=250, Unit="degC")
OCMm_IC2NachiDitherAmp_mA_x = Simulink.Parameter([0 200 400 600 1000 1100 1300 1500], StorageClass="ExportedGlobal", DataType="double", Min=0, Max=2000, Unit="mA")
OCMc_IBOBC2_mA = Simulink.Parameter(0, StorageClass="ExportedGlobal", DataType="double", Min=0, Max=2000, Unit="mA")
OCMm_freqCluSecondaryDitherFreq_Hz_z = Simulink.Parameter(repmat(50, 1, 8), StorageClass="ExportedGlobal", DataType="double", Min=0, Max=500, Unit="Hz")
OCMm_freqCluSecondaryDitherFreq_degC_x = Simulink.Parameter([-40 -20 0 20 50 80 110 140], StorageClass="ExportedGlobal", DataType="double", Min=-120, Max=250, Unit="degC")
OCMc_IBOBLine_mA = Simulink.Parameter(0, StorageClass="ExportedGlobal", DataType="double", Min=0, Max=2000, Unit="mA")

OCMm_ILineNachiDitherAmp_mA_z = Simulink.Parameter([100 100 400 400 500 600 600 600
 100 100 400 400 500 600 600 600
 100 100 400 400 500 600 600 600
 100 100 400 400 500 600 600 600
 100 100 400 400 500 600 600 600
 100 100 400 400 500 600 600 600
 100 100 400 400 500 600 600 600
 100 100 400 400 500 600 600 600], StorageClass="ExportedGlobal", DataType="double", Min=0, Max=2000, Unit="mA")

OCMm_ILineNachiDitherAmp_degC_y = Simulink.Parameter([-40 -20 0 20 50 80 110 140], StorageClass="ExportedGlobal", DataType="double", Min=-120, Max=250, Unit="degC")
OCMm_ILineNachiDitherAmp_mA_x = Simulink.Parameter([0 200 400 600 1000 1100 1300 1500], StorageClass="ExportedGlobal", DataType="double", Min=0, Max=2000, Unit="mA")
OCMm_freqCluLineDitherFreq_Hz_z = Simulink.Parameter(repmat(50, 1, 8), StorageClass="ExportedGlobal", DataType="double", Min=0, Max=500, Unit="Hz")
OCMm_freqCluLineDitherFreq_degC_x = Simulink.Parameter([-40 -20 0 20 50 80 110 140], StorageClass="ExportedGlobal", DataType="double", Min=-120, Max=250, Unit="degC")
OCMm_IBoschLCDitherAmp_mA_z = Simulink.Parameter(repmat(350, 6, 7), StorageClass="ExportedGlobal", DataType="double", Min=0, Max=2000, Unit="mA")
OCMm_IBoschDitherAmp_mA_x = Simulink.Parameter([0 200 400 600 1000 1400], StorageClass="ExportedGlobal", DataType="double", Min=0, Max=2000, Unit="mA")
OCMm_IBoschDitherAmp_degC_y = Simulink.Parameter([-40 -20 0 20 50 80 110], StorageClass="ExportedGlobal", DataType="double", Min=-120, Max=250, Unit="degC")
OCMm_freqLaunchCluDitherFreq_Hz_z = Simulink.Parameter(repmat(50, 1, 8), StorageClass="ExportedGlobal", DataType="double", Min=0, Max=500, Unit="Hz")
OCMm_freqLaunchCluDitherFreq_degC_x = Simulink.Parameter([-40 -20 0 20 50 80 110 140], StorageClass="ExportedGlobal", DataType="double", Min=-120, Max=250, Unit="degC")
OCMc_numBOBSelectLaunchClu = Simulink.Parameter(1, StorageClass="ExportedGlobal", DataType="uint8", Min=0, Max=16, Unit="num")
OCMc_IBOBLauchClu_mA = Simulink.Parameter(1000, StorageClass="ExportedGlobal", DataType="double", Min=0, Max=2000, Unit="mA")
OCMc_IFRCluDitherAmplitude_mA = Simulink.Parameter(0, StorageClass="ExportedGlobal", DataType="double", Unit="mA")
OCMc_IBOBFRClu_mA = Simulink.Parameter(0, StorageClass="ExportedGlobal", DataType="double", Min=0, Max=2000, Unit="mA")
OCMc_numBOBSelectFRClu = Simulink.Parameter(1, StorageClass="ExportedGlobal", DataType="uint8", Min=0, Max=16, Unit="num")
OCMc_freqFRCluDitherFreq_hz = Simulink.Parameter(0, StorageClass="ExportedGlobal", DataType="double", Unit="Hz")
OCMc_numBOBSelectTCC = Simulink.Parameter(1, StorageClass="ExportedGlobal", DataType="uint8", Min=0, Max=16, Unit="num")
OCMc_IBOBTCC_mA = Simulink.Parameter(0, StorageClass="ExportedGlobal", DataType="double", Min=0, Max=2000, Unit="mA")
OCMc_ITCCDitherAmplitude_mA = Simulink.Parameter(0, StorageClass="ExportedGlobal", DataType="double", Unit="mA")
OCMc_freqTCCDitherFreq_hz = Simulink.Parameter(0, StorageClass="ExportedGlobal", DataType="double", Unit="Hz")
OCMc_numBOBSelectSEL = Simulink.Parameter(1, StorageClass="ExportedGlobal", DataType="uint8", Min=0, Max=16, Unit="num")
OCMc_IBOBSEL_mA = Simulink.Parameter(0, StorageClass="ExportedGlobal", DataType="double", Min=0, Max=2000, Unit="mA")
OCMc_ISELDitherAmplitude_mA = Simulink.Parameter(0, StorageClass="ExportedGlobal", DataType="double", Unit="mA")
OCMc_freqSELDitherFreq_hz = Simulink.Parameter(0, StorageClass="ExportedGlobal", DataType="double", Unit="Hz")
OCM_BOOLENABLE = Simulink.Parameter(1, StorageClass="ExportedGlobal", Min=1, Max=1, Unit="bool")
OCM_BOOLDISABLE = Simulink.Parameter(0, StorageClass="ExportedGlobal", DataType="boolean", Min=0, Max=0, Unit="bool")
OCMc_IBOBPTLClu_mA = Simulink.Parameter(0, StorageClass="ExportedGlobal", DataType="double", Min=0, Max=2000, Unit="mA")
OCMm_IBoschPTLDitherAmp_mA_z = Simulink.Parameter(repmat(260, 6, 7), StorageClass="ExportedGlobal", DataType="double", Min=0, Max=2000, Unit="mA")
OCMm_freqPTLCluDitherFreq_Hz_z = Simulink.Parameter([20 30 50 52 52 52 52 52], StorageClass="ExportedGlobal", DataType="double", Min=0, Max=500, Unit="Hz")
OCMm_freqPTLCluDitherFreq_degC_x = Simulink.Parameter([-40 -20 0 20 50 80 110 140], StorageClass="ExportedGlobal", DataType="double", Min=-120, Max=250, Unit="degC")
OCMc_flgIDmdBypassC1ON = Simulink.Parameter(0, StorageClass="ExportedGlobal", DataType="boolean", Min=0, Max=1, Unit="bool")
OCMc_IDmdBypassC1_mA = Simulink.Parameter(0, StorageClass="ExportedGlobal", DataType="double", Min=0, Max=2000, Unit="mA")
OCM_MAXCURRENTCTRLDMD = Simulink.Parameter(1500, StorageClass="ExportedGlobal", DataType="double", Min=0, Max=1800)
OCMc_facMaxDitherWaveformAmp = Simulink.Parameter(1, StorageClass="ExportedGlobal", DataType="double", Min=-1, Max=1, Unit="fac")
OCMc_IDmdBypassC2_mA = Simulink.Parameter(0, StorageClass="ExportedGlobal", DataType="double", Min=0, Max=2000, Unit="mA")
OCMc_IDmdBypassLine_mA = Simulink.Parameter(0, StorageClass="ExportedGlobal", DataType="double", Min=0, Max=2000, Unit="mA")
OCMc_IDmdBypassLC_mA = Simulink.Parameter(0, StorageClass="ExportedGlobal", DataType="double", Min=0, Max=2000, Unit="mA")
OCMc_IDmdBypassPTL_mA = Simulink.Parameter(0, StorageClass="ExportedGlobal", DataType="double", Min=0, Max=2000, Unit="mA")
OCMc_IDmdBypassFR_mA = Simulink.Parameter(0, StorageClass="ExportedGlobal", DataType="double", Min=0, Max=2000, Unit="mA")
OCMc_IDmdTCC_mA = Simulink.Parameter(1000, StorageClass="ExportedGlobal", DataType="double", Min=0, Max=2000, Unit="mA")
OCMc_IDmdSEL_mA = Simulink.Parameter(1000, StorageClass="ExportedGlobal", DataType="double", Min=0, Max=2000, Unit="mA")
OCMc_flgIDmdBypassC2ON = Simulink.Parameter(0, StorageClass="ExportedGlobal", DataType="boolean", Min=0, Max=1, Unit="bool")
OCMc_flgIDmdBypassLineON = Simulink.Parameter(0, StorageClass="ExportedGlobal", DataType="boolean", Min=0, Max=1, Unit="bool")
OCMc_flgIDmdBypassLCON = Simulink.Parameter(0, StorageClass="ExportedGlobal", DataType="boolean", Min=0, Max=1, Unit="bool")
OCMc_flgIDmdBypassPTLON = Simulink.Parameter(0, StorageClass="ExportedGlobal", DataType="boolean", Min=0, Max=1, Unit="bool")
OCMc_flgIDmdBypassFRON = Simulink.Parameter(0, StorageClass="ExportedGlobal", DataType="boolean", Min=0, Max=1, Unit="bool")
OCMc_flgIDmdBypassTCCON = Simulink.Parameter(0, StorageClass="ExportedGlobal", DataType="boolean", Min=0, Max=1, Unit="bool")
OCMc_flgIDmdBypassSELON = Simulink.Parameter(0, StorageClass="ExportedGlobal", DataType="boolean", Min=0, Max=1, Unit="bool")
OCMc_facMinDitherWaveformAmp = Simulink.Parameter(-1, StorageClass="ExportedGlobal", DataType="double", Min=-1, Max=1, Unit="fac")