% Simulink data dictionary pmm_data_mc.sldd

PMMc_pressCluOpenThresh_bar = Simulink.Parameter(2.5, StorageClass="ExportedGlobal", DataType="double", Min=0, Max=5, Unit="bar")
PMMc_timeKeyOffConfirmed_s = Simulink.Parameter(1, StorageClass="ExportedGlobal", DataType="double", Min=0, Max=5, Unit="s")
PMM_STATENOTREADY = Simulink.Parameter(1, StorageClass="ExportedGlobal", DataType="uint8", Min=0, Max=5, Unit="enum")
PMM_STATEREADY = Simulink.Parameter(2, StorageClass="ExportedGlobal", DataType="uint8", Min=0, Max=5, Unit="enum")
PMM_STATESHUTDWN = Simulink.Parameter(3, StorageClass="ExportedGlobal", DataType="uint8", Min=0, Max=5, Unit="enum")
PMM_enumPowerModeState = Simulink.Signal(StorageClass="ExportedGlobal", DataType="uint8", Min=0, Max=5, Unit="enum")
PMMc_numBOBPowerModeState = Simulink.Parameter(0, StorageClass="ExportedGlobal", DataType="uint16", Min=0, Max=11011, Unit="num")
PMMc_enumPowerModeStateBOB = Simulink.Parameter(1, StorageClass="ExportedGlobal", DataType="uint8", Min=1, Max=3, Unit="enum")
PMMc_timeEngStartConsentOn_s = Simulink.Parameter(2, StorageClass="ExportedGlobal", DataType="double", Min=0, Max=5, Unit="s")
PMMc_timeHoldTCUPwrON_s = Simulink.Parameter(3, StorageClass="ExportedGlobal", DataType="double", Min=0, Max=5, Unit="s")
PMMc_flgHoldTCUPwrONEnable = Simulink.Parameter(1, StorageClass="ExportedGlobal", DataType="boolean", Min=0, Max=1, Unit="bool")
PMMc_flgAllPowerSuppliesOn = Simulink.Parameter(1, StorageClass="ExportedGlobal", DataType="boolean", Min=0, Max=1, Unit="bool")
PMMc_timeVrefDPWROffAdvance_s = Simulink.Parameter(0.02, StorageClass="ExportedGlobal", DataType="double", Min=0, Max=1, Unit="s")