% Simulink data dictionary sbs_data_mc.sldd

SBSc_grTrgRatioDmdAmp_rat = Simulink.Parameter(0.05, StorageClass="ExportedGlobal", DataType="double", Min=0, Max=0.2, Unit="rat")
SBSc_BeltLength_m = Simulink.Parameter(0.7091, StorageClass="ExportedGlobal", DataType="double", Min=0, Max=1, Unit="m")
SBSc_CenterDist_m = Simulink.Parameter(0.173, StorageClass="ExportedGlobal", DataType="double", Min=0, Max=1, Unit="m")
SBSc_grODMax_gr = Simulink.Parameter(0.378, StorageClass="ExportedGlobal", DataType="double", Min=0.378, Max=0.378, Unit="rat")
SBSc_trqMinPrimary_Nm = Simulink.Parameter(33.6, StorageClass="ExportedGlobal", DataType="double", Min=0, Max=100, Unit="Nm")
SBSc_trqMinPrimaryEstopOn_Nm = Simulink.Parameter(40, StorageClass="ExportedGlobal", DataType="double", Min=20, Max=100, Unit="Nm")
SBSc_facPrimSFRatFeeze_num = Simulink.Parameter(1.5, StorageClass="ExportedGlobal", DataType="double", Min=1, Max=3, Unit="num")
SBSc_SheaveAngle_rad = Simulink.Parameter(0.192, StorageClass="ExportedGlobal", DataType="double", Min=0.192, Max=0.192, Unit="rad")
SBSc_facSafetyMin_num = Simulink.Parameter(1.5, StorageClass="ExportedGlobal", DataType="double", Min=1, Max=5, Unit="num")
SBSc_facTransitionSafetyMin_num = Simulink.Parameter(2, StorageClass="ExportedGlobal", DataType="double", Min=1.5, Max=5, Unit="fac")
SBSc_facEStopSafetyMin_num = Simulink.Parameter(5, StorageClass="ExportedGlobal", DataType="double", Min=1.2, Max=10, Unit="fac")
SBSc_rateSafetyFactorUP_sfps = Simulink.Parameter(3, StorageClass="ExportedGlobal", DataType="double", Min=0, Max=50, Unit="num")
SBSc_rateSafetyFactorDWN_sfps = Simulink.Parameter(3, StorageClass="ExportedGlobal", DataType="double", Min=0, Max=50, Unit="num")
SBSc_facMuMax_num = Simulink.Parameter(0.095, StorageClass="ExportedGlobal", DataType="double", Unit="num")
SBSc_KIMpa = Simulink.Parameter(0.001, StorageClass="ExportedGlobal", DataType="double", Unit="num")
SBSc_numPrimPiston_area = Simulink.Parameter(0.0183, StorageClass="ExportedGlobal", DataType="double", Min=0, Max=1, Unit="msq")
SBSm_KpKsRatio_x = Simulink.Parameter([0.378 0.497 0.615 0.734 0.852 0.971 1.089 1.208 1.327 1.445 1.564 1.682 1.801 1.92 2.038 2.157 2.275 2.394 2.512 2.631], StorageClass="ExportedGlobal", DataType="double", Unit="num")
SBSm_tempOilSump_degC_x = Simulink.Parameter([-40 -20 0 20 40 60 80 100 150], StorageClass="ExportedGlobal", DataType="double", Min=-40, Max=150, Unit="degC")
SBSm_dRdtGainRatCmdKpKs_y = Simulink.Parameter([0.377999991 0.538857143 0.699714295 0.860571446 1.021428598 1.182285749 1.343142901 1.504000053 1.664857204 1.825714356 1.986571508 2.147428659 2.308285811 2.469142963 2.630000114], StorageClass="ExportedGlobal", DataType="double", Unit="rat")
SBSc_flgUsePIDdRdt = Simulink.Parameter(1, StorageClass="ExportedGlobal", DataType="boolean", Min=0, Max=1, Unit="bool")
SBSc_facdRdtPIMaxSat = Simulink.Parameter(150, StorageClass="ExportedGlobal", DataType="double", Min=0, Max=150, Unit="fac")
SBSc_facdRdtPIMinSat = Simulink.Parameter(-150, StorageClass="ExportedGlobal", DataType="double", Min=-150, Max=0, Unit="fac")

SBSm_facIntWOTPerfGain_z = Simulink.Parameter([0.170000002 0.159999996 0.146999985 0.146999985 0.043555554 0.016333332 0.016333332 0.008166666
 0.170000002 0.159999996 0.146999985 0.146999985 0.065333329 0.024499999 0.024499999 0.01225
 0.170000002 0.159999996 0.146999985 0.146999985 0.09799999 0.03675 0.03675 0.018375
 0.170000002 0.159999996 0.220499978 0.250499994 0.146999985 0.03675 0.03675 0.018375
 0 0 0 0 0 0 0 0], StorageClass="ExportedGlobal", DataType="double", Unit="fac")

SBSm_dRdtGainMeasErr_rat_x = Simulink.Parameter([0 0.02 0.05 0.2 0.21], StorageClass="ExportedGlobal", DataType="double", Unit="rat")
SBSm_dRdtGainRatCmd_y = Simulink.Parameter([0.378 0.7 1.021 1.343 1.665 1.987 2.308 2.63], StorageClass="ExportedGlobal", DataType="double", Unit="rat")

SBSm_facIntWOTStdGain_z = Simulink.Parameter([0 0 0 0 0 0 0 0
 0.150000006 0.150000006 0.150000006 0.150000006 0.150000006 0.002 0.002 0.002
 0.150000006 0.150000006 0.150000006 0.150000006 0.150000006 0.002 0.002 0.002
 0.150000006 0.150000006 0.150000006 0.150000006 0.150000006 0.01 0.01 0.01
 0.150000006 0.150000006 0.150000006 0.150000006 0.150000006 0.01 0.01 0.01
 0.150000006 0.150000006 0.150000006 0.150000006 0.150000006 0.01 0.01 0.01
 0.150000006 0.150000006 0.150000006 0.150000006 0.150000006 0.002 0.002 0.002
 0.150000006 0.150000006 0.150000006 0.150000006 0.150000006 0.002 0.002 0.002
 0 0 0 0 0 0 0 0], StorageClass="ExportedGlobal", DataType="double", Unit="fac")

SBSm_dRdtGainSignMeasErr_rat_x = Simulink.Parameter([-0.5 -0.2 -0.05 -0.02 0 0.02 0.05 0.2 0.5], StorageClass="ExportedGlobal", DataType="double", Unit="rat")

SBSm_facIntHiGain_z = Simulink.Parameter([0.04 0.04 0.025 0.02 0.01 0.01 0.01 0.01
 0.04 0.04 0.025 0.02 0.01 0.01 0.01 0.01
 0.2 0.2 0.025 0.02 0.01 0.01 0.01 0.01
 0.2 0.2 0.025 0.02 0.01 0.01 0.01 0.01
 0.2 0.2 0.025 0.02 0.01 0.01 0.01 0.01], StorageClass="ExportedGlobal", DataType="double", Unit="fac")

SBSm_facIntLoGain_z = Simulink.Parameter([0.04 0.04 0.025 0.02 0.01 0.01 0.01 0.01
 0.04 0.04 0.025 0.02 0.01 0.01 0.01 0.01
 0.2 0.2 0.025 0.02 0.01 0.01 0.01 0.01
 0.2 0.2 0.025 0.02 0.01 0.01 0.01 0.01
 0.2 0.2 0.025 0.02 0.01 0.01 0.01 0.01], StorageClass="ExportedGlobal", DataType="double", Unit="fac")

SBSc_flgIGainHiSelectON = Simulink.Parameter(0, StorageClass="ExportedGlobal", DataType="boolean", Min=0, Max=1, Unit="bool")
SBSc_flgIGainManON = Simulink.Parameter(0, StorageClass="ExportedGlobal", DataType="boolean", Min=0, Max=1, Unit="bool")

SBSm_facIntWOTPerfMaxSat_z = Simulink.Parameter([0 0 0 0 0 0 0 0
 0 0 0 0 0 0 0 0
 1 0.300000012 0.275000036 0.275000036 0.275000036 0 0 0
 2 0.5 0.400000006 0.400000006 0.400000006 0 0 0
 3 0.599999905 0.599999905 0.550000072 0.350000083 0 0 0
 3 0.599999905 0.350000083 0.549999952 0.450000078 0 0 0
 3 0.599999905 0.350000083 0.350000083 0.450000078 0 0 0
 3 0.950000107 0.50000006 0.349999994 0.600000083 0 0 0
 0 0 0 0 0 0 0 0], StorageClass="ExportedGlobal", DataType="double", Min=0, Max=4, Unit="rat")

SBSm_dRdtGainErr_rat_x = Simulink.Parameter([-3 -0.2 -0.05 -0.007 0 0.007 0.05 0.2 3], StorageClass="ExportedGlobal", DataType="double", Unit="rat")

SBSm_facIntWOTStdMaxSat_z = Simulink.Parameter([0 0 0 0 0 0 0 0
 0 0 0 0 0 0 0 0
 1.100000143 0.100000002 0 0 0 0 0 0
 1.200000167 0.200000003 0.100000002 0.100000002 0 0 0 0
 1.200000167 0.400000036 0.300000012 0.300000012 0 0 0 0
 1.300000191 0.450000048 0.300000012 0.300000012 0 0 0 0
 1.400000215 0.50000006 0.300000012 0.300000012 0 0 0 0
 1.200000167 0.550000072 0.25 0.25 0 0 0 0
 0.900000095 0.400000036 0.200000018 0.200000018 0 0 0 0], StorageClass="ExportedGlobal", DataType="double", Min=0, Max=4, Unit="rat")

SBSm_facIntCruiseMaxSat_z = Simulink.Parameter([0 0 0 0 0 0 0 0
 0 0 0 0 0 0 0 0.100000002
 1.700000048 1.5 0 0 0 0 0.5 0.5
 1.799999952 1.600000024 0.600000024 0.499999911 0.5 0.5 0.5 0.5
 1.799999952 1.600000024 0.600000024 0.499999911 0.5 0.5 0.5 0.5
 1.799999952 1.600000024 0.600000024 0.499999911 0.499999911 0.499999911 0.499999911 0.499999911
 1.799999952 1.600000024 0.600000024 0.499999911 0.499999911 0.499999911 0.499999911 0.499999911
 1.799999952 1.600000024 0.600000024 0.499999911 0.499999911 0.499999911 0.499999911 0.499999911
 1.799999952 1.600000024 0.600000024 0.499999911 0.499999911 0.499999911 0.499999911 0.499999911], StorageClass="ExportedGlobal", DataType="double", Unit="rat")

SBSm_facIntWOTPerfMinSat_z = Simulink.Parameter([-5 -3 -0.5 -0.5 -0.5 -0.5 -0.300000012 0
 -5 -3 -0.5 -0.5 -0.5 -0.5 -0.300000012 0
 -5 -3 -0.5 -0.5 -0.5 -0.5 -0.300000012 0
 -5 -3 -0.5 -0.5 -0.5 -0.5 -0.300000012 0
 -5 -3 -0.400000006 -0.400000006 -0.400000006 -0.400000006 0 0
 -5 -3 -0.150000006 -0.150000006 -0.150000006 -0.150000006 0 0
 0 0 0 0 0 0 0 0
 0 0 0 0 0 0 0 0
 0 0 0 0 0 0 0 0], StorageClass="ExportedGlobal", DataType="double", Unit="rat")

SBSm_facIntWOTStdMinSat_z = Simulink.Parameter([-3 -2 0 0 0 0 0 0
 -3 -2 -0.5 -0.5 -0.5 0 0 0
 -3 -2 -0.5 -0.5 -0.5 0 0 0
 -3 -2 -0.5 -0.5 -0.5 0 0 0
 -3 -2 -0.5 -0.5 -0.5 0 0 0
 -3 -2 -0.300000012 -0.300000012 -0.300000012 0 0 0
 0 0 -0.100000016 -0.100000016 -0.100000016 0 0 0
 0 0 0 0 0 0 0 0
 0 0 0 0 0 0 0 0], StorageClass="ExportedGlobal", DataType="double", Unit="rat")

SBSm_facIntCruiseMinSat_z = Simulink.Parameter([0 0 -0.5 -0.5 -0.5 -0.5 -0.5 -0.5
 -1 0 -0.5 -0.5 -0.5 -0.5 -0.5 -0.5
 -2 -1 -0.5 -0.5 -0.5 -0.5 -0.5 -0.5
 -3 -1 -0.100000002 -0.100000002 -0.100000002 -0.100000002 -0.100000002 -0.100000002
 -3 -1 0 0 0 0 0 0
 -3 -1 0 0 0 0 0 0
 -2 0 0 0 0 0 0 0
 -1 0 0 0 0 0 0 0
 0 0 0 0 0 0 0 0], StorageClass="ExportedGlobal", DataType="double", Unit="rat")

SBSm_dRdtPGainMeasErr_rat_x = Simulink.Parameter([0 0.05 0.2 0.5], StorageClass="ExportedGlobal", DataType="double", Unit="rat")

SBSm_facPropWOTPerfGain_z = Simulink.Parameter([19 19 19 18 17 10 4 3
 19 19 19 18 17 10 4 3
 19 19 19 18 17 10 4 3
 19 19 19 18 17 10 4 3], StorageClass="ExportedGlobal", DataType="double", Unit="fac")

SBSm_facPropWOTStdGain_z = Simulink.Parameter([19 19 19 16 10 7 5 4
 19 19 19 16 10 7 5 4
 19 19 19 16 10 7 5 4
 19 19 19 16 10 7 5 4], StorageClass="ExportedGlobal", DataType="double", Unit="fac")

SBSm_facPropHiGain_z = Simulink.Parameter([16 10 6 5 4 3 3 3
 16 10 6 5 4 3 3 3
 16 10 6 5 4 3 3 3
 16 10 6 5 4 3 3 3], StorageClass="ExportedGlobal", DataType="double", Unit="fac")

SBSm_facPropLoGain_z = Simulink.Parameter([7 4 2 1 1 1 1 1
 7 4 2 1 1 1 1 1
 7 4 2 1 1 1 1 1
 7 4 2 1 1 1 1 1], StorageClass="ExportedGlobal", DataType="double", Unit="fac")

SBSc_flgPGainHiSelectON = Simulink.Parameter(0, StorageClass="ExportedGlobal", DataType="boolean", Min=0, Max=1, Unit="bool")
SBSc_spdGainAFOne_mph = Simulink.Parameter(11, StorageClass="ExportedGlobal", DataType="double", Min=5, Max=25, Unit="mph")
SBSc_spdGainAFNorm_mph = Simulink.Parameter(9, StorageClass="ExportedGlobal", DataType="double", Min=3, Max=20, Unit="mph")
SBSc_flgUse1DAFGains = Simulink.Parameter(0, StorageClass="ExportedGlobal", DataType="boolean", Min=0, Max=1, Unit="bool")
SBSm_facStdGainAuthority_z = Simulink.Parameter([0.7 0 0 0 0.2 1 1], StorageClass="ExportedGlobal", DataType="double", Min=0, Max=2, Unit="fac")
SBSm_facGainAuthority_x = Simulink.Parameter([0 0.01 0.1 0.3 0.5 0.75 0.95], StorageClass="ExportedGlobal", DataType="double", Min=0, Max=1, Unit="fac")

SBSm_factDCCtrlAFGains_fac_z = Simulink.Parameter([0.1 0.3 0.5 0.6 1
 0.1 0.3 0.5 0.6 1
 0.1 0.3 0.5 0.6 1
 0.1 0.3 0.5 0.6 1
 0.1 0.3 0.5 0.6 1
 0.1 0.3 0.5 0.6 1], StorageClass="ExportedGlobal", DataType="double", Min=0, Max=1, Unit="fac")

SBSm_trqRefEngineAFGains_Nm_x = Simulink.Parameter([0 10 50 100 200 300], StorageClass="ExportedGlobal", DataType="double", Min=0, Max=500, Unit="Nm")
SBSm_spdEngAFGains_rpm_y = Simulink.Parameter([700 1500 2000 3000 4000], StorageClass="ExportedGlobal", DataType="double", Min=0, Max=9000, Unit="rpm")

SBSm_factCtrlAFGains_fac_z = Simulink.Parameter([0 0.100000002 0.300000012 0.600000024 1
 0 0.100000002 0.300000012 0.600000024 1
 0 0.100000002 0.300000012 0.600000024 1
 0 0.100000002 0.300000012 0.600000024 1
 0 0.100000002 0.300000012 0.600000024 1
 0 0.100000002 0.300000012 0.600000024 1
 1 1 1 1 1], StorageClass="ExportedGlobal", DataType="double", Min=0, Max=1, Unit="fac")

SBSc_flgUseDCSpecificAF = Simulink.Parameter(1, StorageClass="ExportedGlobal", DataType="boolean", Min=0, Max=1, Unit="bool")
SBSm_pctCtrlAFGainsPedal_pct_x = Simulink.Parameter([0 1 10 30 50 75 95], StorageClass="ExportedGlobal", DataType="double", Min=0, Max=100, Unit="pct")
SBSm_facPerfGainAuthority_z = Simulink.Parameter([0.7 0 0.00125 0.05 0.3 1 1], StorageClass="ExportedGlobal", DataType="double", Min=0, Max=1, Unit="fac")
SBSc_numDerRatFiltConst = Simulink.Parameter(0.05, StorageClass="ExportedGlobal", DataType="double", Min=0, Max=1, Unit="num")
SBSc_grUDMax_gr = Simulink.Parameter(2.631, StorageClass="ExportedGlobal", DataType="double", Min=2.631, Max=2.631, Unit="rat")
SBSc_trqPrimaryMax_Nm = Simulink.Parameter(5000, StorageClass="ExportedGlobal", DataType="double", Unit="Nm")
SBSc_trqPrimaryMin_Nm = Simulink.Parameter(1, StorageClass="ExportedGlobal", DataType="double", Unit="Nm")
SBSc_facBaseSecForceMultiplier = Simulink.Parameter(1.5, StorageClass="ExportedGlobal", DataType="double", Min=1, Max=10, Unit="fac")
SBSc_trqSecondaryMax_Nm = Simulink.Parameter(5000, StorageClass="ExportedGlobal", DataType="double", Unit="Nm")
SBSc_trqSecondaryMin_Nm = Simulink.Parameter(1, StorageClass="ExportedGlobal", DataType="double", Unit="Nm")
SBSc_facPrimCentrCoeff = Simulink.Parameter(0.028, StorageClass="ExportedGlobal", DataType="double", Min=0.028, Max=0.028, Unit="fac")
SBSc_pressMaxClu_Pa = Simulink.Parameter(4800000, StorageClass="ExportedGlobal", DataType="double", Min=0, Max=7000000, Unit="Pa")
SBSc_pressMinPrimClu_Pa = Simulink.Parameter(300000, StorageClass="ExportedGlobal", DataType="double", Min=0, Max=7000000, Unit="Pa")
SBSc_facSecCentrCoeff = Simulink.Parameter(0.0136, StorageClass="ExportedGlobal", DataType="double", Min=0.0136, Max=0.0136, Unit="fac")
SBSc_nSpringPreload_N = Simulink.Parameter(411.5556, StorageClass="ExportedGlobal", DataType="double", Unit="N")
SBSc_trqSecSpringK_Nm = Simulink.Parameter(33630.796, StorageClass="ExportedGlobal", DataType="double", Unit="Nm")
SBSc_numSecPiston_area = Simulink.Parameter(0.0123, StorageClass="ExportedGlobal", DataType="double", Min=0, Max=1, Unit="msq")
SBSc_pressMinSecClu_Pa = Simulink.Parameter(200000, StorageClass="ExportedGlobal", DataType="double", Min=0, Max=7000000, Unit="Pa")
SBSc_pressC1MinDmd_bar = Simulink.Parameter(2, StorageClass="ExportedGlobal", DataType="double", Min=0, Max=70, Unit="bar")
SBSc_numC2PressFiltConst = Simulink.Parameter(0.9, StorageClass="ExportedGlobal", DataType="double", Min=0, Max=10, Unit="num")
SBSc_numC1PressFiltConst = Simulink.Parameter(0.9, StorageClass="ExportedGlobal", DataType="double", Min=0, Max=10, Unit="num")
SBSc_flgC1PressFiltOn = Simulink.Parameter(1, StorageClass="ExportedGlobal", DataType="boolean", Min=0, Max=1, Unit="bool")
SBSc_flgC2PressFiltOn = Simulink.Parameter(1, StorageClass="ExportedGlobal", DataType="boolean", Min=0, Max=1, Unit="bool")
SBSc_flgSaturationsOn = Simulink.Parameter(1, StorageClass="ExportedGlobal", DataType="boolean", Min=0, Max=1, Unit="bool")
SBSc_flgPGainManON = Simulink.Parameter(0, StorageClass="ExportedGlobal", DataType="boolean", Min=0, Max=1, Unit="bool")

SBSm_KpKsGain_z = Simulink.Parameter([1 1 1 1 1 1 1 1 1 1.070000053 1.070000053 1.070000053 1.070000053 1.070000053 1.070000053
 1 1 1 1 1 1 1 1 1 1.070000053 1.070000053 1.070000053 1.070000053 1.070000053 1.070000053
 1 1 1 1 1 1 1 1 1 1.070000053 1.070000053 1.070000053 1.070000053 1.070000053 1.070000053
 1 1 1 1 1 1 1 1 1 1.070000053 1.070000053 1.070000053 1.070000053 1.070000053 1.070000053
 1 1 1 1 1 1 1 1 1 1.070000053 1.070000053 1.070000053 1.070000053 1.070000053 1.070000053
 1 1 1 1 1 1 1 1 1 1.070000053 1.070000053 1.070000053 1.070000053 1.070000053 1.070000053
 1 1 1 1 1 1 1 1 1 1.070000053 1.070000053 1.070000053 1.070000053 1.070000053 1.070000053
 1 1 1 1 1 1 1 1 1 1.070000053 1.070000053 1.070000053 1.070000053 1.070000053 1.070000053
 1 1 1 1 1 1 1 1 1 1.070000053 1.070000053 1.070000053 1.070000053 1.070000053 1.070000053], StorageClass="ExportedGlobal", DataType="double", Unit="fac")

SBSm_KpKsSafepct_y = Simulink.Parameter([-100 -90 -80 -70 -60 -50 -40 -30 -20 -10 0 10 20 30 40 50 60 70 80 90 100], StorageClass="ExportedGlobal", DataType="double", Unit="rat")

SBSm_KpKs_z = Simulink.Parameter([1.063060006 1.050161053 1.0372621 1.030812259 1.03081153 1.030810801 1.098467465 1.166124129 1.265981933 1.398040878 1.530099822 1.607398039 1.684696256 1.754983964 1.818261165 1.881538365 1.950318704 2.019099042 2.054610969 2.056854484 2.059097999
 1.035786842 1.01307009 0.990353338 0.978994951 0.978994931 0.97899491 1.039015222 1.099035534 1.191255878 1.315676254 1.44009663 1.527213362 1.614330093 1.690072717 1.754441232 1.818809747 1.878861568 1.93891339 1.968970756 1.969033668 1.969096579
 1.008513684 0.985513684 0.959376 0.927176 0.927176 0.927176 0.986976 1.044335579 1.120235579 1.244435579 1.350095158 1.437495158 1.528032842 1.624632842 1.689032842 1.756081474 1.815881474 1.872892421 1.884392421 1.884392421 1.879095158
 0.981240526 0.958240526 0.907557 0.875357 0.875357 0.875357 0.935157 0.973425368 1.049325368 1.168093737 1.260093737 1.347493737 1.462577263 1.559177263 1.624353211 1.693353211 1.753153211 1.788345632 1.799845632 1.798293737 1.789093737
 0.953967368 0.920138 0.855738 0.823538 0.823538 0.823538 0.874915158 0.902515158 0.978415158 1.078092316 1.170092316 1.268321684 1.397121684 1.493721684 1.561624947 1.630624947 1.680798842 1.703798842 1.715298842 1.708292316 1.699092316
 0.926694211 0.868319 0.803919 0.771719 0.771719 0.771719 0.804004947 0.831604947 0.896090895 0.988090895 1.080090895 1.202866105 1.331666105 1.429896684 1.498896684 1.567896684 1.596252053 1.619252053 1.627490895 1.618290895 1.609090895
 0.878842105 0.814442105 0.750042105 0.726073684 0.726073684 0.726073684 0.753673684 0.781273684 0.843131579 0.935131579 1.014784211 1.143584211 1.272384211 1.358936842 1.427936842 1.509284211 1.532284211 1.555284211 1.551894737 1.542694737 1.525263158
 0.824295789 0.759895789 0.705436632 0.682436632 0.682436632 0.682436632 0.710036632 0.740121842 0.802221842 0.893110579 0.957510579 1.086310579 1.200199316 1.285299316 1.355410579 1.452010579 1.475010579 1.485584526 1.480984526 1.471043684 1.443443684
 0.769749474 0.707799579 0.661799579 0.638799579 0.638799579 0.638799579 0.667012105 0.699212105 0.761312105 0.835836947 0.900236947 1.025361789 1.126561789 1.211661789 1.298136947 1.394736947 1.414674316 1.414674316 1.410074316 1.389224211 1.361624211
 0.715203158 0.664162526 0.618162526 0.595162526 0.595162526 0.595162526 0.626102368 0.658302368 0.714163316 0.778563316 0.842963316 0.951724263 1.052924263 1.144263316 1.240863316 1.337463316 1.343764105 1.343764105 1.335004737 1.307404737 1.279804737
 0.675328421 0.629328421 0.583328421 0.567664211 0.567664211 0.567664211 0.599864211 0.632064211 0.680364211 0.744764211 0.807697053 0.908897053 1.010097053 1.107529895 1.204129895 1.293394105 1.293394105 1.293394105 1.283995579 1.256395579 1.225861263
 0.648055263 0.602055263 0.565527632 0.554027632 0.554027632 0.554027632 0.586227632 0.618427632 0.666727632 0.731127632 0.791333158 0.892533158 0.991838684 1.088438684 1.185038684 1.260666316 1.260666316 1.266349737 1.259449737 1.231849737 1.195860789
 0.620782105 0.574891053 0.551891053 0.540391053 0.540391053 0.540391053 0.572591053 0.604791053 0.653091053 0.715169263 0.774969263 0.876147474 0.972747474 1.069347474 1.154338526 1.227938526 1.228003895 1.241803895 1.234903895 1.202660316 1.165860316
 0.593508947 0.561254474 0.538254474 0.526754474 0.526754474 0.526754474 0.558954474 0.591154474 0.639005368 0.698805368 0.758605368 0.857056263 0.953656263 1.048010737 1.121610737 1.195210737 1.203458053 1.217258053 1.209459842 1.172659842 1.135859842
 0.566235789 0.543235789 0.520235789 0.513117895 0.513117895 0.520129263 0.552329263 0.584529263 0.630529263 0.690329263 0.7475 0.8441 0.9407 1.020541474 1.094141474 1.164235789 1.178035789 1.191835789 1.180335789 1.143535789 1.112870737
 0.538962632 0.515962632 0.499481316 0.499481316 0.499481316 0.528311211 0.560511211 0.592711211 0.638711211 0.698511211 0.7475 0.8441 0.932877579 1.004177579 1.077777579 1.136962632 1.150762632 1.164562632 1.153062632 1.116262632 1.104688789
 0.511689474 0.488689474 0.485844737 0.485844737 0.499693158 0.536493158 0.568693158 0.600893158 0.646893158 0.7015 0.7475 0.8441 0.916513684 0.987813684 1.054489474 1.109689474 1.123489474 1.137289474 1.125789474 1.101106842 1.096506842
 0.484416316 0.472208158 0.472208158 0.472208158 0.507875105 0.544675105 0.576875105 0.609075105 0.655075105 0.7015 0.7475 0.831149789 0.900149789 0.971449789 1.027216316 1.082416316 1.096216316 1.110016316 1.098516316 1.092924895 1.088324895
 0.457143158 0.457714446 0.458285733 0.477428515 0.515142792 0.552857068 0.58505703 0.617256991 0.656185551 0.701842709 0.747499867 0.81581431 0.884128753 0.945657459 1.000400427 1.055143395 1.068943345 1.082743295 1.087743205 1.083943076 1.080142947
 0.429870004 0.43589515 0.441920296 0.468154128 0.514596646 0.561039164 0.593238756 0.625438349 0.662730237 0.70511442 0.747498602 0.809268298 0.871037993 0.927112772 0.977492635 1.027872497 1.04167197 1.055471443 1.064289143 1.068125069 1.071960995], StorageClass="ExportedGlobal", DataType="double", Unit="fac")

SBSm_spdCtrlAFGainsVehSpd_mph_y = Simulink.Parameter([0 3 5 10 20], StorageClass="ExportedGlobal", DataType="double", Min=0, Max=20, Unit="mph")
SBSc_pressC2MinDmd_bar = Simulink.Parameter(2, StorageClass="ExportedGlobal", DataType="double", Min=0, Max=70, Unit="bar")
SBSc_flgPTLDragRemovalON = Simulink.Parameter(1, StorageClass="ExportedGlobal", DataType="boolean", Min=0, Max=1, Unit="bool")
SBSc_facPTLGain = Simulink.Parameter(0.0494, StorageClass="ExportedGlobal", DataType="double", Min=0, Max=0.0532, Unit="fac")
SBSc_facPTLCentCoeff = Simulink.Parameter(0.0005031, StorageClass="ExportedGlobal", DataType="double", Min=0, Max=0.002, Unit="fac")
SBSc_facPTLSecTorqueSF = Simulink.Parameter(1.3, StorageClass="ExportedGlobal", DataType="double", Min=1, Max=3, Unit="fac")
SBS_ENUMSBSPARKNTRL = Simulink.Parameter(1, StorageClass="ExportedGlobal", DataType="uint8", Min=1, Max=1, Unit="enum")
SBS_ENUMSBSINIT = Simulink.Parameter(0, StorageClass="ExportedGlobal", DataType="uint8", Min=0, Max=0, Unit="enum")
SBS_ENUMSBSRATFREEZE = Simulink.Parameter(3, StorageClass="ExportedGlobal", DataType="uint8", Min=3, Max=3, Unit="enum")
SBS_ENUMSBSDRIVE = Simulink.Parameter(2, StorageClass="ExportedGlobal", DataType="uint8", Min=2, Max=2, Unit="enum")
SBSc_pressLineMinimum_bar = Simulink.Parameter(5, StorageClass="ExportedGlobal", DataType="double", Min=0, Max=20, Unit="bar")
SBSc_pressLineOffset_bar = Simulink.Parameter(3, StorageClass="ExportedGlobal", DataType="double", Min=0, Max=12, Unit="bar")
SBSc_flgLinePressFiltOn = Simulink.Parameter(0, StorageClass="ExportedGlobal", DataType="boolean", Min=0, Max=1, Unit="bool")
SBSc_numLinePressFiltConst = Simulink.Parameter(0.05, StorageClass="ExportedGlobal", DataType="double", Min=0, Max=1, Unit="num")
SBSc_pressC1MaxDmd_bar = Simulink.Parameter(70, StorageClass="ExportedGlobal", DataType="double", Min=0, Max=70, Unit="bar")
SBSc_pressC2MaxDmd_bar = Simulink.Parameter(48, StorageClass="ExportedGlobal", DataType="double", Min=0, Max=70, Unit="bar")
SBSc_pressPTLMaxDmd_bar = Simulink.Parameter(55, StorageClass="ExportedGlobal", DataType="double", Min=0, Max=70, Unit="bar")
SBSc_pressPTLMinDmd_bar = Simulink.Parameter(0, StorageClass="ExportedGlobal", DataType="double", Min=0, Max=70, Unit="bar")
SBSc_pressLineMaxDmd_bar = Simulink.Parameter(70, StorageClass="ExportedGlobal", DataType="double", Min=0, Max=70, Unit="bar")
SBSc_pressLineMinDmd_bar = Simulink.Parameter(1, StorageClass="ExportedGlobal", DataType="double", Min=0, Max=70, Unit="bar")
SBSc_pressC2WOTMaxDmd_bar = Simulink.Parameter(48, StorageClass="ExportedGlobal", DataType="double", Min=10, Max=48, Unit="bar")
SBSc_pressDmdPTLBypass_bar = Simulink.Parameter(0, StorageClass="ExportedGlobal", DataType="double", Min=0, Max=70, Unit="bar")
SBSc_flgPressDmdPTLBypassON = Simulink.Parameter(0, StorageClass="ExportedGlobal", DataType="boolean", Min=0, Max=1, Unit="bool")
SBSc_pressDmdLineBypass_bar = Simulink.Parameter(0, StorageClass="ExportedGlobal", DataType="double", Min=0, Max=70, Unit="bar")
SBSc_flgPressDmdLineBypassON = Simulink.Parameter(0, StorageClass="ExportedGlobal", DataType="boolean", Min=0, Max=1, Unit="bool")
SBSc_ratePressDmdSecUP_barps = Simulink.Parameter(5000, StorageClass="ExportedGlobal", DataType="double", Min=0, Max=5000, Unit="barps")
SBSc_ratePressDmdSecDWN_barps = Simulink.Parameter(5000, StorageClass="ExportedGlobal", DataType="double", Min=0, Max=5000, Unit="barps")
SBSc_flgPressDmdC2BypassON = Simulink.Parameter(0, StorageClass="ExportedGlobal", DataType="boolean", Min=0, Max=1, Unit="bool")
SBSc_pressDmdC2Bypass_bar = Simulink.Parameter(0, StorageClass="ExportedGlobal", DataType="double", Min=0, Max=70, Unit="bar")
SBSc_pressDmdC1Bypass_bar = Simulink.Parameter(0, StorageClass="ExportedGlobal", DataType="double", Min=0, Max=70, Unit="bar")
SBSc_flgPressDmdC1BypassON = Simulink.Parameter(0, StorageClass="ExportedGlobal", DataType="boolean", Min=0, Max=1, Unit="bool")
SBSc_ratePressDmdPrimUP_barps = Simulink.Parameter(5000, StorageClass="ExportedGlobal", DataType="double", Min=0, Max=5000, Unit="barps")
SBSc_ratePressDmdPrimDWN_barps = Simulink.Parameter(5000, StorageClass="ExportedGlobal", DataType="double", Min=0, Max=5000, Unit="barps")
SBSm_IP2CC1_mA_z = Simulink.Parameter([1000 950 900 850 800 750 700 650 600 550 500 450 400 350 300 250 200], StorageClass="ExportedGlobal", DataType="double", Min=0, Max=2000, Unit="mA")
SBSm_IP2CC1_bar_x = Simulink.Parameter([0 0.304333333 1.533333333 4.653333333 8.276666667 11.81333333 15.12333333 18.91666667 21.98666667 25.16666667 28.02333333 30.73 34.04333333 35.86333333 37.04666667 37.97333333 39], StorageClass="ExportedGlobal", DataType="double", Min=0, Max=70, Unit="bar")
SBSc_fackIC1_num = Simulink.Parameter(-0.2, StorageClass="ExportedGlobal", DataType="double", Min=-100, Max=100, Unit="fac")
SBSc_facValvePIMaxSat = Simulink.Parameter(150, StorageClass="ExportedGlobal", DataType="double", Min=0, Max=2000, Unit="num")
SBSc_facValvePIMinSat = Simulink.Parameter(-150, StorageClass="ExportedGlobal", DataType="double", Min=-2000, Max=0, Unit="num")
SBSc_IMesValMaxSat_mA = Simulink.Parameter(950, StorageClass="ExportedGlobal", DataType="double", Min=0, Max=2000, Unit="mA")
SBSc_IMesValMinSat_mA = Simulink.Parameter(0, StorageClass="ExportedGlobal", DataType="double", Min=0, Max=2000, Unit="mA")
SBSm_IP2CC2_mA_z = Simulink.Parameter([950 900 850 800 750 700 650 600 550 500], StorageClass="ExportedGlobal", DataType="double", Min=0, Max=2000, Unit="mA")
SBSm_IP2CC2_bar_x = Simulink.Parameter([0 1.256666667 6.2 12.79 18.6 24.20333333 29.61666667 34.92666667 39.64333333 53], StorageClass="ExportedGlobal", DataType="double", Min=0, Max=70, Unit="bar")
SBSm_facC2ValveMaxSat_x = Simulink.Parameter([50 50 0], StorageClass="ExportedGlobal", DataType="double", Min=-250, Max=250, Unit="mA")
SBSm_facC2ValveMinSat_x = Simulink.Parameter([-50 -50 0], StorageClass="ExportedGlobal", DataType="double", Min=-250, Max=250, Unit="mA")
SBSc_IMesC2ValMaxSat_mA = Simulink.Parameter(950, StorageClass="ExportedGlobal", DataType="double", Min=0, Max=2000, Unit="mA")
SBSc_IMesC2ValMinSat_mA = Simulink.Parameter(0, StorageClass="ExportedGlobal", DataType="double", Min=0, Max=2000, Unit="mA")
SBSm_facITermC2_z = Simulink.Parameter([-0.01 -0.02 -0.05 -0.1 -0.2 -0.2 -0.2 -0.2 -0.2], StorageClass="ExportedGlobal", DataType="double", Unit="fac")
SBSc_flgLineComp = Simulink.Parameter(0, StorageClass="ExportedGlobal", DataType="boolean", Min=0, Max=1, Unit="bool")
SBSm_IP2CPTL_mA_z = Simulink.Parameter([260 364 400 450 500 550 600 650 700 750 800 850 900 950 1000], StorageClass="ExportedGlobal", DataType="double", Min=0, Max=2000, Unit="mA")
SBSm_IP2CPTL_bar_x = Simulink.Parameter([0 1.7 3 4.5 6.7 8 9.5 10.7 13 16 18 20 22 24 26], StorageClass="ExportedGlobal", DataType="double", Min=0, Max=70, Unit="bar")
SBSc_fackIPTL_num = Simulink.Parameter(0.2, StorageClass="ExportedGlobal", DataType="double", Min=0, Max=10, Unit="num")
SBSm_IP2CLine_mA_z = Simulink.Parameter([950 900 850 800 750 700 650 600 550 500 450 400 350 300 250 200], StorageClass="ExportedGlobal", DataType="double", Min=0, Max=2000, Unit="mA")
SBSm_IP2CLine_bar_x = Simulink.Parameter([3.97 5.3 9.793333333 16.20666667 22.00666667 25.26 30.77 38.12 42.37666667 42.88 48.35666667 51.21 53.84333333 57.68 58.05666667 61], StorageClass="ExportedGlobal", DataType="double", Min=0, Max=70, Unit="bar")
SBSc_fackILine_num = Simulink.Parameter(-0.2, StorageClass="ExportedGlobal", DataType="double", Min=-100, Max=100, Unit="num")
SBSc_IHydLCValMaxSat_mA = Simulink.Parameter(1400, StorageClass="ExportedGlobal", DataType="double", Min=0, Max=2000, Unit="num")
SBSc_IHydLCValMinSat_mA = Simulink.Parameter(0, StorageClass="ExportedGlobal", DataType="double", Min=0, Max=2000, Unit="num")
SBSm_fackPLine_y = Simulink.Parameter([0 0 0 -20 -20], StorageClass="ExportedGlobal", DataType="double", Unit="fac")
SBSm_pressLineError_bar_x = Simulink.Parameter([-1000 0 5 20 1000], StorageClass="ExportedGlobal", DataType="double", Unit="bar")
SBSc_spdEngTCCSELON_rpm = Simulink.Parameter(2600, StorageClass="ExportedGlobal", DataType="double", Min=2000, Max=3000, Unit="rpm")
SBSc_spdEngTCCSELOFF_rpm = Simulink.Parameter(2400, StorageClass="ExportedGlobal", DataType="double", Min=2000, Max=3000, Unit="rpm")
SBSc_pressPrimMinBackshift_bar = Simulink.Parameter(1, StorageClass="ExportedGlobal", Min=0, Max=5, Unit="bar")
SBSc_pressSecMaxBackshift_bar = Simulink.Parameter(48, StorageClass="ExportedGlobal", DataType="double", Min=10, Max=48, Unit="bar")
SBSc_timeDebounceC2Track_s = Simulink.Parameter(0.1, StorageClass="ExportedGlobal", DataType="double", Min=0, Max=1, Unit="s")
SBSc_timeDebounceC1Track_s = Simulink.Parameter(0.1, StorageClass="ExportedGlobal", DataType="double", Min=0, Max=1, Unit="s")
SBSc_numBOBSBSActive = Simulink.Parameter(0, StorageClass="ExportedGlobal", DataType="uint16", Min=0, Max=11011, Unit="num")
SBSc_flgSBSActivated = Simulink.Parameter(0, StorageClass="ExportedGlobal", DataType="boolean", Min=0, Max=1, Unit="bool")
SBSc_pressC1ActThrld_bar = Simulink.Parameter(2, StorageClass="ExportedGlobal", DataType="double", Min=0, Max=3, Unit="bar")
SBSc_pressC2ActThrld_bar = Simulink.Parameter(2, StorageClass="ExportedGlobal", DataType="double", Min=0, Max=3, Unit="bar")
SBSc_flgRatioCmdBypassON = Simulink.Parameter(1, StorageClass="ExportedGlobal", DataType="boolean", Min=0, Max=1, Unit="bool")
SBSm_C2PressError_bar_y = Simulink.Parameter([0 3 7], StorageClass="ExportedGlobal", DataType="double", Min=0, Max=20, Unit="bar")
SBSc_grTrgRatioCmdBypass = Simulink.Parameter(2.631, StorageClass="ExportedGlobal", DataType="double", Min=0.378, Max=2.631, Unit="rat")
SBSc_ratReverseMinSat_rat = Simulink.Parameter(0.4, StorageClass="ExportedGlobal", DataType="double", Min=0.378, Max=2.631, Unit="rat")
SBSc_ratReverseMaxSat_rat = Simulink.Parameter(2.631, StorageClass="ExportedGlobal", DataType="double", Min=2.631, Max=2.7, Unit="rat")