% Simulink data dictionary sys_data_mc.sldd

SYSc_timeInitialise_s = Simulink.Parameter(0.2, StorageClass="ExportedGlobal", DataType="double", Min=0, Max=1, Unit="s")
SYS_STATEINIT = Simulink.Parameter(1, StorageClass="ExportedGlobal", DataType="uint8", Min=0, Max=255, Unit="enum")
SYS_STATEFAULT = Simulink.Parameter(25, StorageClass="ExportedGlobal", DataType="uint8", Min=0, Max=255, Unit="enum")
SYS_STATECHARACTERISE = Simulink.Parameter(10, StorageClass="ExportedGlobal", DataType="uint8", Min=0, Max=255, Unit="enum")
SYS_STATESHUTDOWN = Simulink.Parameter(5, StorageClass="ExportedGlobal", DataType="uint8", Min=0, Max=255, Unit="enum")
SYS_STATEDRIVEICE = Simulink.Parameter(4, StorageClass="ExportedGlobal", DataType="uint8", Min=0, Max=255, Unit="enum")
SYS_STATENTRL = Simulink.Parameter(3, StorageClass="ExportedGlobal", DataType="uint8", Min=0, Max=255, Unit="enum")
SYS_STATEPARK = Simulink.Parameter(2, StorageClass="ExportedGlobal", DataType="uint8", Min=0, Max=255, Unit="enum")
SYS_enumSystemState = Simulink.Signal(StorageClass="ExportedGlobal", DataType="uint8", Min=0, Max=255, Unit="enum")
SYSc_flgCharacteriseON = Simulink.Parameter(0, StorageClass="ExportedGlobal", DataType="boolean", Min=0, Max=1, Unit="bool")