% Simulink data dictionary rxl_data_mc.sldd

RXL_GAIN14BITADCCONV_Vpbit = Simulink.Parameter(0.00030519, StorageClass="ExportedGlobal", DataType="double", Min=0.00030519, Max=0.00030519, Unit="b2V")
RXL_vADCAI2_V = Simulink.Signal(StorageClass="ExportedGlobal", DataType="double", Min=0, Max=18, Unit="V")
RXL_vADCAI3_V = Simulink.Signal(StorageClass="ExportedGlobal", DataType="double", Min=0, Max=18, Unit="V")
RXL_vADCAI4_V = Simulink.Signal(StorageClass="ExportedGlobal", DataType="double", Min=0, Max=18, Unit="V")
RXL_vADCPressPilotSens_V = Simulink.Signal(StorageClass="ExportedGlobal", DataType="double", Min=0, Max=18, Unit="V")
RXL_vADCAI1_V = Simulink.Signal(StorageClass="ExportedGlobal", DataType="double", Min=0, Max=18, Unit="V")
RXL_vADCGPSSens_V = Simulink.Signal(StorageClass="ExportedGlobal", DataType="double", Min=0, Max=18, Unit="V")
RXL_enumDIEStop = Simulink.Signal(StorageClass="ExportedGlobal", DataType="uint8", Min=0, Max=255, Unit="enum")
RXL_enumDIDescModeSw1 = Simulink.Signal(StorageClass="ExportedGlobal", DataType="uint8", Min=0, Max=255, Unit="enum")
RXL_enumDIKL15 = Simulink.Signal(StorageClass="ExportedGlobal", DataType="uint8", Min=0, Max=255, Unit="enum")
RXL_enumVFSFault = Simulink.Signal(StorageClass="ExportedGlobal", DataType="uint8", Min=0, Max=255, Unit="enum")
RXL_enumDIIn1 = Simulink.Signal(StorageClass="ExportedGlobal", DataType="uint8", Min=0, Max=255, Unit="enum")
RXL_enumDIIn4 = Simulink.Signal(StorageClass="ExportedGlobal", DataType="uint8", Min=0, Max=255, Unit="enum")
RXL_enumDIIn3 = Simulink.Signal(StorageClass="ExportedGlobal", DataType="uint8", Min=0, Max=255, Unit="enum")
RXL_enumDIIn2 = Simulink.Signal(StorageClass="ExportedGlobal", DataType="uint8", Min=0, Max=255, Unit="enum")
RXL_enumDIDescModeSw2 = Simulink.Signal(StorageClass="ExportedGlobal", DataType="uint8", Min=0, Max=255, Unit="enum")
RXL_enumDIIn5 = Simulink.Signal(StorageClass="ExportedGlobal", DataType="uint8", Min=0, Max=255, Unit="enum")
RXL_signSpdOSSSigned = Simulink.Signal(StorageClass="ExportedGlobal", DataType="double", Min=-1, Max=1, Unit="num")
RXL_spdOSSChn1_Hz = Simulink.Signal(StorageClass="ExportedGlobal", DataType="double", Min=0, Max=1000, Unit="Hz")
RXL_spdOSSChn2_Hz = Simulink.Signal(StorageClass="ExportedGlobal", DataType="double", Min=0, Max=1000, Unit="Hz")
RXL_countEdgesOSS = Simulink.Signal(StorageClass="ExportedGlobal", DataType="double", Min=-7000, Max=7000, Unit="Edges")
RXL_countEdgesSpdSec = Simulink.Signal(StorageClass="ExportedGlobal", DataType="double", Min=-7000, Max=7000, Unit="Edges")
RXL_countEdgesSpdPrim = Simulink.Signal(StorageClass="ExportedGlobal", DataType="double", Min=-7000, Max=7000, Unit="Edges")
RXL_spdSecondary_Hz = Simulink.Signal(StorageClass="ExportedGlobal", DataType="double", Min=0, Max=1000, Unit="Hz")
RXL_spdPrimary_Hz = Simulink.Signal(StorageClass="ExportedGlobal", DataType="double", Min=0, Max=1000, Unit="Hz")
RXL_vPressPTLClu_V = Simulink.Signal(StorageClass="ExportedGlobal", DataType="double", Min=0, Max=18, Unit="V")
RXL_vPressLaunchClu_V = Simulink.Signal(StorageClass="ExportedGlobal", DataType="double", Min=0, Max=18, Unit="V")
RXL_vPressLine_V = Simulink.Signal(StorageClass="ExportedGlobal", DataType="double", Min=0, Max=18, Unit="V")
RXL_vPressC1_V = Simulink.Signal(StorageClass="ExportedGlobal", DataType="double", Min=0, Max=18, Unit="V")
RXL_vPressC2_V = Simulink.Signal(StorageClass="ExportedGlobal", DataType="double", Min=0, Max=18, Unit="V")
RXL_vTempOilSump_V = Simulink.Signal(StorageClass="ExportedGlobal", DataType="double", Min=0, Max=18, Unit="V")