% Simulink data dictionary tst_data_mc.sldd

TSTc_rateSlowBarRamp_barps = Simulink.Parameter(0.7, StorageClass="ExportedGlobal", DataType="double", Min=0.1, Max=1, Unit="barps")
TSTc_rateFastBarRamp_barps = Simulink.Parameter(15, StorageClass="ExportedGlobal", DataType="double", Min=1, Max=20, Unit="barps")
TSTc_pressRampFinal_bar = Simulink.Parameter(15, StorageClass="ExportedGlobal", DataType="double", Unit="bar")
TSTc_pressRampStart_bar = Simulink.Parameter(0, StorageClass="ExportedGlobal", DataType="double", Unit="bar")
TSTc_flgLCRampFcnOn = Simulink.Parameter(0, StorageClass="ExportedGlobal", DataType="boolean", Min=0, Max=1, Unit="boolean")
TSTc_flgTestOn = Simulink.Parameter(0, StorageClass="ExportedGlobal", DataType="boolean", Min=0, Max=1, Unit="boolean")
TSTc_IRampFinal_A = Simulink.Parameter(1, StorageClass="ExportedGlobal", DataType="double", Unit="A")
TSTc_IRampStart_A = Simulink.Parameter(1, StorageClass="ExportedGlobal", DataType="double", Unit="A")
TSTc_timeValveCharStep_s = Simulink.Parameter(0.1, StorageClass="ExportedGlobal", DataType="double", Unit="s")
TSTc_IValveCharStep_A = Simulink.Parameter(0.005, StorageClass="ExportedGlobal", DataType="double", Unit="A")
TSTc_IMaxValveChar_A = Simulink.Parameter(1, StorageClass="ExportedGlobal", DataType="double", Unit="A")
TSTc_rateIRamp_Aps = Simulink.Parameter(4, StorageClass="ExportedGlobal", DataType="double", Unit="Aps")